# Dynamo graph create-project.dyn (Dynamo 2.10.1.3976)
# packages: DynaWeb 1.0.3

string = StringInput("Project ID")
string_2 = StringInput("Text")
byName = GlobalParameter.ByName(name=string, parameterType=string_2)
string_3 = StringInput("http://localhost:3000")
byUrl = DynaWeb.WebClient.ByUrl(baseUrl=string_3)
code_block = CodeBlock { "/api/project"; }
byEndpoint = DynaWeb.WebRequest.ByEndpoint(endpoint=code_block)
string_4 = StringInput("Content-Type")
string_5 = StringInput("application/json")
addHeader = DynaWeb.WebRequest.AddHeader(webRequest=byEndpoint, name=string_4, value=string_5)
string_6 = StringInput("POST")
setMethod = DynaWeb.WebRequest.SetMethod(webRequest=addHeader, method=string_6)
string_7 = StringInput("undefined")
string_8 = StringInput("New Project3")  # graph input
python_script = Python(IN[0]=string_8)  # CPython3
# ---------- python_script.python (16 lines) ----------
# Load the Python Standard and DesignScript Libraries
import sys
import clr
clr.AddReference('ProtoGeometry')
from Autodesk.DesignScript.Geometry import *

# The inputs to this node will be stored as a list in the IN variables.
dataEnteringNode = IN

# Place your code below this line
import json

project_title = IN[0]

# Assign your output to the OUT variable.
OUT = json.dumps({'title':project_title})
# ----------------------------------------
string_9 = StringInput("RequestBody")
addParameter = DynaWeb.WebRequest.AddParameter(webRequest=setMethod, name=string_7, value=python_script, parameterType=string_9)
execute = DynaWeb.WebClient.Execute(client=byUrl, request=addParameter)
content = DynaWeb.WebResponse.Content(webResponse=execute)
watch = Watch(content)
python_script_2 = Python(IN[0]=watch)  # CPython3
# ---------- python_script_2.python (14 lines) ----------
# Load the Python Standard and DesignScript Libraries
import sys
import clr
clr.AddReference('ProtoGeometry')
from Autodesk.DesignScript.Geometry import *

# The inputs to this node will be stored as a list in the IN variables.
dataEnteringNode = IN

# Place your code below this line
import json

# Assign your output to the OUT variable.
OUT = str(json.loads(IN[0])['id'])
# ----------------------------------------
setValue = GlobalParameter.SetValue(parameter=byName, value=python_script_2)
string_10 = StringInput("Project Title")
string_11 = StringInput("Text")
byName_2 = GlobalParameter.ByName(name=string_10, parameterType=string_11)
python_script_3 = Python(IN[0]=watch)  # CPython3
# ---------- python_script_3.python (14 lines) ----------
# Load the Python Standard and DesignScript Libraries
import sys
import clr
clr.AddReference('ProtoGeometry')
from Autodesk.DesignScript.Geometry import *

# The inputs to this node will be stored as a list in the IN variables.
dataEnteringNode = IN

# Place your code below this line
import json

# Assign your output to the OUT variable.
OUT = json.loads(IN[0])['title']
# ----------------------------------------
setValue_2 = GlobalParameter.SetValue(parameter=byName_2, value=python_script_3)
