# Dynamo graph fetch-comments.dyn (Dynamo 2.10.1.3976)
# packages: DynaWeb 1.0.3

element_types = ElementTypes("ViewPlan")
all_elements_of_type = ElementsOfType(element_type=element_types)
string = StringInput("Revit.Elements.Views.FloorPlanView")
type = Object.Type(obj=all_elements_of_type)
eq = string == type
filterByBoolMask = List.FilterByBoolMask(list=all_elements_of_type, mask=eq)
string_2 = StringInput("http://localhost:3000")
byUrl = DynaWeb.WebClient.ByUrl(baseUrl=string_2)
string_3 = StringInput("Project ID")
findByName = GlobalParameter.FindByName(name=string_3)
value = GlobalParameter.Value(globalParameter=findByName)
toNumber = String.ToNumber(str=value)
code_block = CodeBlock(projectId=toNumber) { "/api/project/"+projectId; }
byEndpoint = DynaWeb.WebRequest.ByEndpoint(endpoint=code_block)
string_4 = StringInput("GET")
setMethod = DynaWeb.WebRequest.SetMethod(webRequest=byEndpoint, method=string_4)
execute = DynaWeb.WebClient.Execute(client=byUrl, request=setMethod)
content = DynaWeb.WebResponse.Content(webResponse=execute)
python_script = Python(IN[0]=content)  # CPython3
# ---------- python_script.python (29 lines) ----------
# Load the Python Standard and DesignScript Libraries
import sys
import clr
clr.AddReference('ProtoGeometry')
from Autodesk.DesignScript.Geometry import *

# The inputs to this node will be stored as a list in the IN variables.
dataEnteringNode = IN

# Place your code below this line

import json

data = json.loads(IN[0])

levels = data['levels']

names = []
comments = []

for level in levels:
    names.append(level['name'])
    comments.append([comment['message'] for comment in level['comments']])
    



# Assign your output to the OUT variable.
OUT = [names,comments]
# ----------------------------------------
code_block_2 = CodeBlock(data=python_script) { data[0]; }
watch = Watch(filterByBoolMask.in)
name = Element.Name(element=watch)
eq_2 = code_block_2 == name  # lacing=CrossProduct
filterByBoolMask_2 = List.FilterByBoolMask(list=filterByBoolMask.in, mask=eq_2@L2)
comment_x_offset = DoubleInput(-5000)  # graph input
comment_y_offset = DoubleInput(-12000)  # graph input
comment_y_spacing = DoubleInput(-1000)  # graph input
code_block_3 = CodeBlock(data=python_script) { data[1]; }
count = List.Count(list=code_block_3@L2)
code_block_4 = CodeBlock(x=comment_y_offset, y=comment_y_spacing, z=count) { x+(y)*(z-1); }
range = Range(start=comment_y_offset, end=code_block_4, step=comment_y_spacing)
byCoordinates = Point.ByCoordinates(x=comment_x_offset, y=range)
string_5 = StringInput("Left")
byLocation = TextNote.ByLocation(view=filterByBoolMask_2.in@L1, location=byCoordinates@L2, text=code_block_3@L2, alignment=string_5)
