# Dynamo graph sync-project.dyn (Dynamo 2.10.1.3976)
# packages: bimorphNodes 4.2.1, DynaWeb 1.0.3

views = Views("Sheets for Web")  # graph input
fromSchedule = Revit.Sheet.FromSchedule(scheduleView=views)
code_block = CodeBlock { "Include Sheet in Web"; }
getParameterValueByName = Element.GetParameterValueByName(element=fromSchedule, parameterName=code_block)
code_block_2 = CodeBlock { 1; }
eq = getParameterValueByName == code_block_2
filterByBoolMask = List.FilterByBoolMask(list=fromSchedule, mask=eq)
sheetName = Sheet.SheetName(sheet=filterByBoolMask.in)
schedules = Sheet.Schedules(sheet=filterByBoolMask.in)
scheduleView = ScheduleOnSheet.ScheduleView(scheduleOnSheet=schedules)
name = Element.Name(element=scheduleView)
watch = Watch(name)
code_block_3 = CodeBlock { 0; }
getDataRows = Revit.Schedule.GetDataRows(scheduleView=scheduleView, rowIndexes=code_block_3)
boolean = BoolSelector(true)
getData = Revit.Schedule.GetData(scheduleView=scheduleView, removeHeading=boolean)
byKeysValues = DesignScript.Builtin.Dictionary.ByKeysValues(keys=getDataRows@L3, values=getData@L2, lacing=CrossProduct)
fields = ScheduleView.Fields(scheduleView=scheduleView)
name_2 = Revit.Schedules.ScheduleField.Name(scheduleField=fields)
string = StringInput("http://localhost:3000")
byUrl = DynaWeb.WebClient.ByUrl(baseUrl=string)
string_2 = StringInput("Project ID")
findByName = GlobalParameter.FindByName(name=string_2)
value = GlobalParameter.Value(globalParameter=findByName)
toNumber = String.ToNumber(str=value)
code_block_4 = CodeBlock(projectId=toNumber) { "/api/project/"+projectId+"/schedule"; }
byEndpoint = DynaWeb.WebRequest.ByEndpoint(endpoint=code_block_4)
string_3 = StringInput("Content-Type")
string_4 = StringInput("application/json")
addHeader = DynaWeb.WebRequest.AddHeader(webRequest=byEndpoint, name=string_3, value=string_4)
string_5 = StringInput("POST")
setMethod = DynaWeb.WebRequest.SetMethod(webRequest=addHeader, method=string_5)
string_6 = StringInput("undefined")
python_script = Python(IN[0]=getDataRows, IN[1]=getData, IN[2]=name, IN[3]=toNumber)  # CPython3
# ---------- python_script.python (70 lines) ----------
# Load the Python Standard and DesignScript Libraries
import sys
import clr
clr.AddReference('ProtoGeometry')
from Autodesk.DesignScript.Geometry import *

# The inputs to this node will be stored as a list in the IN variables.
dataEnteringNode = IN

# Place your code below this line
import json

all_sheet_headings = IN[0]

all_sheet_data = IN[1]

all_schedule_titles = IN[2]

project_id = IN[3]

sheet_count = len(all_sheet_headings)

all_schedules_as_array = []

debug = []
for i in range(sheet_count):
	schedules_headings = all_sheet_headings[i]
	schedules_data = all_sheet_data[i]
	schedule_count_on_sheet = len(schedules_headings)
	schedule_titles = all_schedule_titles[i]
	debug.append("New Sheet")
	for j in range(schedule_count_on_sheet):
		schedule_headings = schedules_headings[j][0]
		schedule_data = schedules_data[j]
		schedule_title = schedule_titles[j]
		schedule_headings_count = len(schedule_headings)
		schedule_as_array_of_json_objs = []
		debug.append("New Schedule")
		debug.append(schedule_title)
		debug.append("Schedule Headings count")
		debug.append(schedule_headings_count)
		debug.append("Schedule # of Data Rows:")
		debug.append(len(schedule_data))
		debug.append("Schedule Fields:")
		debug.append(schedule_headings)
		for data_row in schedule_data:
			schedule_entry = {}
			for k in range(schedule_headings_count):
				field_name = schedule_headings[k]
				debug.append("Field name: ")
				debug.append(field_name)
				field_value = data_row[k]
				debug.append("field value: ")
				debug.append(field_value)
				test = f'Test'
				# debug.append("field_name: "+str(field_name))
				# debug.append("field_value: "+str(field_value))
				
				schedule_entry[field_name]=field_value
			schedule_as_array_of_json_objs.append(schedule_entry)
			
		schedule = {'title':schedule_title, 'data':schedule_as_array_of_json_objs,
		'headings':schedule_headings, 'projectId':project_id}
		all_schedules_as_array.append(schedule)
		
	

# Assign your output to the OUT variable.
OUT = json.dumps(all_schedules_as_array)
#OUT = debug
# ----------------------------------------
watch_2 = Watch(python_script)
string_7 = StringInput("RequestBody")
addParameter = DynaWeb.WebRequest.AddParameter(webRequest=setMethod, name=string_6, value=watch_2, parameterType=string_7)
execute = DynaWeb.WebClient.Execute(client=byUrl, request=addParameter)
content = DynaWeb.WebResponse.Content(webResponse=execute)
watch_3 = Watch(content)
string_8 = StringInput("/api/schedules")
string_9 = StringInput("tables")
watch_4 = Watch(python_script)
code_block_5 = CodeBlock(projectId=toNumber) { "/api/project/"+projectId+"/rooms"; }
byEndpoint_2 = DynaWeb.WebRequest.ByEndpoint(endpoint=code_block_5)
string_10 = StringInput("Content-Type")
string_11 = StringInput("application/json")
addHeader_2 = DynaWeb.WebRequest.AddHeader(webRequest=byEndpoint_2, name=string_10, value=string_11)
string_12 = StringInput("POST")
setMethod_2 = DynaWeb.WebRequest.SetMethod(webRequest=addHeader_2, method=string_12)
string_13 = StringInput("undefined")
rooms_by_status = RoomsByStatus()
string_14 = StringInput("Level")
getParameterValueByName_2 = Element.GetParameterValueByName(element=rooms_by_status.PlacedRooms, parameterName=string_14)
name_3 = Room.Name(room=rooms_by_status.PlacedRooms)
location = Room.Location(room=rooms_by_status.PlacedRooms)
finishBoundary = Room.FinishBoundary(room=rooms_by_status.PlacedRooms)
startPoint = Curve.StartPoint(curve=finishBoundary)
endPoint = Curve.EndPoint(curve=finishBoundary)
number = Room.Number(room=rooms_by_status.PlacedRooms)
python_script_2 = Python(IN[0]=getParameterValueByName_2, IN[1]=name_3, IN[2]=location, IN[3]=startPoint, IN[4]=endPoint, IN[5]=number, IN[6]=toNumber)  # CPython3
# ---------- python_script_2.python (51 lines) ----------
# Load the Python Standard and DesignScript Libraries
import sys
import clr
clr.AddReference('ProtoGeometry')
from Autodesk.DesignScript.Geometry import *

# The inputs to this node will be stored as a list in the IN variables.
dataEnteringNode = IN

# Place your code below this line
import json

room_levels = IN[0]

room_names = IN[1]

room_locations = IN[2]

edge_starts = IN[3]

edge_ends = IN[4]

room_numbers = IN[5]

project_id = IN[6]

all_room_data = []
for i in range(len(room_names)): 
    room_name = room_names[i]
    room_level = room_levels[i]
    room_location = room_locations[i]
    room_number = room_numbers[i]
    data = {
    'name': room_name, 
    'levelName':room_level, 
    'location':(room_location.X,room_location.Y,room_location.Z),
    'number':room_number,
    'projectId':int(project_id),
    'edges':[]
    }
    edge_start_points = edge_starts[i][0]
    edge_end_points = edge_ends[i][0]
    for k in range(len(edge_start_points)):
        start = edge_start_points[k]
        end = edge_end_points[k]
        edge = [(start.X,start.Y,start.Z),(end.X,end.Y,end.Z)]
        data['edges'].append(edge)
    all_room_data.append(data)

# Assign your output to the OUT variable.
OUT = json.dumps(all_room_data)
# ----------------------------------------
string_15 = StringInput("RequestBody")
addParameter_2 = DynaWeb.WebRequest.AddParameter(webRequest=setMethod_2, name=string_13, value=python_script_2, parameterType=string_15)
execute_2 = DynaWeb.WebClient.Execute(client=byUrl, request=addParameter_2)
content_2 = DynaWeb.WebResponse.Content(webResponse=execute_2)
watch_5 = Watch(content_2)
